# Grasshopper definition model.gh (Grasshopper 0.9.76)
# plug-ins: Python Interpreter

# material resistance
# angleA
# material resistance
# angleB
# force
# speed
# angleA
# angleB
# force
# speed
# angleA
# angleB
# force
# speed
# angleA
# angleB
# speed
# material resistance
# material resistance
# force
# force
# angleA
# angleA
# angleB
# angleB
# speed
# speed
# force
# force
# angleA
# angleA
# angleB
# angleB
# speed
# speed
show = BooleanToggle(False)
# angleB
# speed
# data for further calculation
# set path
# set path
# set path
# set path
# set path
# set path
# set path
# force
# force
# force
# force
# force
# force
# angleA
# angleA
# angleA
# angleA
# angleA
# angleA
# angleB
# angleB
# angleB
# angleB
# angleB
# angleB
# speed
# speed
# speed
# speed
# speed
# speed
# force
# force
# force
# force
# force
# force
# angleA
# angleA
# angleA
# angleA
# angleA
# angleA
# angleA
# angleA
# angleA
# angleA
# angleA
# angleA
# angleA
# angleB
# angleB
# angleB
# angleB
# angleB
# angleB
# speed
# speed
# speed
# speed
# speed
# speed
# speed
# speed
# speed
# speed
# speed
# speed
# speed
# data for further calculation
# data for further calculation
# data for further calculation
# data for further calculation
# data for further calculation
# data for further calculation
# material resistance
# force
# angleA
# angleB
# speed
# force
# angleA
# angleB
# speed
bang = Button()

# ---- group: breps
base_shoulder = Brep(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)
upperarm = Brep(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)
forearm = Brep(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)
wrist1 = Brep(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)
wrist2 = Brep(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)
wrist3 = Brep(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)

base_shoulder_2 = Brep(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)
upperarm_2 = Brep(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)
forearm_2 = Brep(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)
wrist3_2 = Brep(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)
wrist1_2 = Brep(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)
wrist2_2 = Brep(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)

# ----
planeswcs = Plane()

# ----
# material resistance
# force
# angleA
# angleB
# speed
# force
# angleA
# angleB
# speed
# material resistance
# force
# angleA
# angleB
# speed
# force
# angleA
# angleB
# speed
animate = Button()
commands = PythonScript(planesWCS=planeswcs, animate=animate)  # -> planes, tool_planes; inputs planesWCS: list
# ---------- commands: Python ----------
from scriptcontext import sticky as st
from mas_lib.robots.communication.msg_identifiers import *
import Rhino.Geometry as rg

ur5 = st["ur_model"]

planes = []

tool_planes = []

TT = rg.Transform.PlaneToPlane(ur5.tool.plane, rg.Plane.WorldXY)

for plane in planesWCS:
    
    
    #pose_RCS = ur5.get_tool_pose_in_RCS(plane)
    #tcp_plane = ur5.get_tcp_plane_from_pose_angle_axis(pose_RCS)
    
    tool_plane = ur5.get_tool_plane_in_RCS(plane)
    
    
    """
    T2 = rg.Transform.PlaneToPlane(rg.Plane.WorldXY, tool_plane)
    print tool_plane
    
    T = T2 * TT 
    
    tcp_plane = rg.Plane.WorldXY
    
    tcp_plane.Transform(T)
    """
    
    tcp_plane = ur5.get_tcp_plane_in_RCS(plane)
    
    planes.append(tcp_plane)
    tool_planes.append(tool_plane)
# ---------- end commands ----------

unload = PythonScript(bang=bang)
# ---------- unload: Python ----------
from compas_fabrication.fabrication.utilities.utilities import unload_module

unload_module("compas")
# ---------- end unload ----------

# ---- group: Robot
# 1. load robot model
# 2. set tool
# 3. set basis
list = ValueList({"measurement_tool"}, selected="measurement_tool")
base = PythonScript(bang=bang)  # -> base_frame
# ---------- base: Python ----------
from compas_fabrication.fabrication.geometry import Frame
from compas.geometry.elements import Vector

origin = [300,300,0]
xaxis  = [0, 1, 0]
yaxis  = [1, 0, 0]

base_frame = Frame(list(origin), list(xaxis), list(yaxis))
# ---------- end base ----------
tools = Tools(bang=bang, tool_name=list)
list_2 = ValueList({"UR5", "UR10"}, selected="UR10")
robot = PythonScript(bang=bang, model=list_2, tool=tools, base_frame=base)  # -> robot
# ---------- robot: Python ----------
from compas_fabrication.fabrication.robots.ur.ur10 import UR10
from compas_fabrication.fabrication.robots.ur.ur5 import UR5

if model == "UR5":
    robot = UR5()
elif model == "UR10":
    robot = UR10()
    
robot.set_tool(tool)
robot.set_base(base_frame)
# ---------- end robot ----------

# ----
# Animate current commands
# Calculate spring extension
change_joint_position = Button()

ur5_brep = Geometry([base_shoulder, upperarm, forearm, wrist1, wrist2, wrist3])
ur10_geo = Geometry([base_shoulder_2, upperarm_2, forearm_2, wrist1_2, wrist2_2, wrist3_2])
pt = Point(Point(-148.4213181, -51.83235683, -807.6767189))
xy = XYPlane(Origin=pt)

# ----
# otherG = insert other mesh geometry for intersection check
# The joint values along the path
number_slider = Slider(2, range=0..7)
joint_check = PythonScript(ur_planes_tcp_RCS=commands.planes, maxdiff=number_slider)  # -> out, joints, idxs; inputs ur_planes_tcp_RCS: list
# ---------- joint_check: Python ----------
import math
import Rhino.Geometry as rg
from mas_lib.robots.ur.kinematic.joint_check import joint_check_all_start_indices

if len(ur_planes_tcp_RCS):

    all_joints = joint_check_all_start_indices(ur_planes_tcp_RCS, maxdiff)
    
    idxs = [all_joints[i][0] for i in range(len(all_joints))]
    joints = [all_joints[i][1] for i in range(len(all_joints))]
    
    print idxs
# ---------- end joint_check ----------
possible_positions = Panel(joint_check.out)
select_position = PythonScript(joints=joint_check.joints, idxs=joint_check.idxs, step=change_joint_position)  # -> joints, idx; inputs joints: list, idxs: list
# ---------- select_position: Python ----------
from scriptcontext import sticky as st
from mas_lib.robots.ur.kinematic.joint_check import get_smallest_solution

guid = str(ghenv.Component.InstanceGuid) # guid of this individual component
current_idx = "current_idx_" + guid

if current_idx not in st:
    st[current_idx] = 0

if step:
    st[current_idx] = (st[current_idx] + 1) % len(idxs)

try:
    idx = idxs[st[current_idx]]
except:
    st[current_idx] = 0
joints = joints[st[current_idx]]

print joints
# ---------- end select_position ----------
idx = Panel(select_position.idx)
check = BooleanToggle(True)
intersect = PythonScript(joints=select_position.joints, idxs=select_position.idx, check=check)  # -> joints, LCs, IGs; inputs joints: list, idxs: list, otherG: list of Mesh
# ---------- intersect: Python ----------
import Rhino.Geometry as rg
import ghpythonlib.components as ghcomp
import math
from scriptcontext import sticky as st

ur5 = st["ur_model"]

LCs = []
IGs = []

def check_intersect_mesh(robotG, toolG, otherG=[]):
    
    """Check joint intersection"""
    for i in range(len(robotG)):
        if i+1 == len(robotG):
            break
        checkG = robotG[i+2:]
        checkG += toolG
        if i > 0: # the base is not checked with intersections to otherG
            checkG += otherG

        for gb in checkG:
            #print i, robotG[i]
            lc = rg.Intersect.Intersection.MeshMeshFast(robotG[i], gb)
            #rg.Intersect.Intersection.MeshMeshAccurate(robotG[i], gb, 0.1)
            #rc, lc, lp = rg.Intersect.Intersection.BrepBrep(robotG[i], gb, 0.1)
            if len(lc):
                return True, lc
    
    
    # check tool intersection
    for gb in otherG:
        #rc, lc, lp = rg.Intersect.Intersection.BrepBrep(toolG, gb, 0.1)
        lc = rg.Intersect.Intersection.MeshMeshFast(toolG, gb)
        if len(lc):
            return True, lc

    return False, []
    

def check_intersection_path_mesh(ur5, joints, otherG=[]):
    
    """Check intersection for a whole path == of already computed joints"""
    for i, q in enumerate(joints):

        link_geo, axes, tcp_plane, tool_plane, workspace, tool_geo = ur5.get_geo_with_rotated_joints(q)
        
        check, lc = check_intersect_mesh(link_geo, tool_geo, otherG)
        if check:
            return True, lc, link_geo + tool_geo
    return False, [], link_geo + tool_geo
    

if check and joints != [None]:
    
    intersect, lc, IG = check_intersection_path_mesh(ur5, joints, otherG)

    if intersect:
        LCs.append(lc)
        IGs.append(IG)
        #raise Exception("Has intersection")
        joints = []
# ---------- end intersect ----------
py = PythonScript(L=intersect.joints)  # -> T, TT; inputs L: list
# ---------- py: Python ----------
from mas_lib.useful.gh_useful import list_to_tree

if L != [None]:

    T = list_to_tree(L)
    TT = list_to_tree(zip(*L)) # zip(*L) transposes the list
# ---------- end py ----------
the_joints = QuickGraph(py.TT)

select_configuration = Slider(0, range=0..7)
crv = Curve(<curve referenced from the Rhino model>)
hframes = HorizontalFrames(Curve=crv, Count=Slider(30, range=0..100))  # -> Frames, Parameters
python = PythonScript(robot=robot, planes=hframes.Frames, idx=select_configuration)  # -> out, a; inputs planes: list, idx: Int32
# ---------- python: Python ----------
from compas_fabrication.fabrication.geometry import Frame
from compas_fabrication.fabrication.robots.ur.kinematics.ur_kinematics import calculate_configurations_for_path

frames_WCS = [Frame(plane.Origin, plane.XAxis, plane.YAxis) for plane in planes]
frames_RCS = [robot.get_frame_in_RCS(tcp_WCS) for tcp_WCS in frames_WCS]
frames_tool0_RCS = [robot.get_tool0_frame_from_tcp_frame(tcp_RCS) for tcp_RCS in frames_RCS]

ur_params = robot.params
configurations = calculate_configurations_for_path(frames_tool0_RCS, ur_params)

for x in configurations:
    print len(x)
# ---------- end python ----------

# ---- group: define angles, forward kinematics
base_2 = Slider(-70.23, range=-360..360)
shoulder = Slider(-41.27, range=-360..360)
elbow = Slider(-81.926, range=-360..360)
wrist1_3 = Slider(73.752, range=-360..360)
wrist2_3 = Slider(159.906, range=-360..360)
wrist3_3 = Slider(-65.828, range=-360..360)
ur1_q1_q6 = Data([base_2, wrist3_3, shoulder, wrist2_3, elbow, wrist1_3])
rad = Radians(Degrees=ur1_q1_q6)

# ----
item = ListItem(List=hframes.Frames, Index=Slider(100, range=0..100), Wrap=True)

# ---- group: define plane in WCS, calculate inverse
select_configuration_2 = Slider(0, range=0..7)
plane_wcs = Plane(item)
inverse = PythonScript(robot=robot, plane_WCS=plane_wcs, idx=select_configuration_2)  # -> configuration; inputs plane_WCS: Plane, idx: Int32
# ---------- inverse: Python ----------
import Rhino.Geometry as rg
from compas_fabrication.fabrication.geometry import Frame, Transformation
from compas_fabrication.fabrication.grasshopper import xdraw_frame

tcp_WCS = Frame(plane_WCS.Origin, plane_WCS.XAxis, plane_WCS.YAxis)

# transform frame to robot coordinate system
tcp_RCS = robot.get_frame_in_RCS(tcp_WCS)

# get the frame of tool0
tool0_RCS = robot.get_tool0_frame_from_tcp_frame(tcp_RCS)

# calculate solutions to frame
solutions = robot.inverse_kinematics(tool0_RCS)

if not len(solutions):
    q = [0,0,0,0,0,0]
else:
    idx = min(len(solutions) - 1, idx)
    q = solutions[idx]
    
print q

configuration = q
# ---------- end inverse ----------

# ----
list_3 = ValueList({"0 forward, from angles": 0, "1 inverse, from plane single": 1, "2 inverse, from plane multiple": 2}, selected="1 inverse, from plane single")
filter = StreamFilter(Gate=list_3, Stream0=rad, Stream1=inverse)
draw = PythonScript(robot=robot, configuration=filter)  # -> meshes, tool0_plane, tcp_plane; inputs configuration: list
# ---------- draw: Python ----------
from compas_fabrication.fabrication.grasshopper import xdraw_frame
from compas_fabrication.fabrication.grasshopper import draw_mesh 
from compas_fabrication.fabrication.grasshopper import xform_from_transformation
from compas_fabrication.fabrication.geometry import Frame, Transformation
from compas_fabrication.fabrication.geometry.helpers import mesh_update_vertices

import Rhino.Geometry as rg
import Rhino

q = configuration


R0, R1, R2, R3, R4, R5 = robot.get_forward_transformations(q)

m0, m1, m2, m3, m4, m5, tool0_frame, tcp_frame = robot.get_transformed_model(q)
mt = robot.get_transformed_tool_model(tcp_frame)


meshes = []
meshes.append(draw_mesh(m0))
meshes.append(draw_mesh(m1))
meshes.append(draw_mesh(m2))
meshes.append(draw_mesh(m3))
meshes.append(draw_mesh(m4))
meshes.append(draw_mesh(m5))
meshes.append(draw_mesh(mt))

tool0_plane = xdraw_frame(tool0_frame)
tcp_plane = xdraw_frame(tcp_frame)
# ---------- end draw ----------
panel = Panel("visualize")
pln = Plane(draw.tcp_plane)
pln_2 = Plane(draw.tool0_plane)

timestep = Slider(10, range=0..10)
timer = PythonScript(start=animate, timestep=timestep, array=intersect.joints)  # -> item; inputs array: list
# ---------- timer: Python ----------
from scriptcontext import sticky as st
from mas_lib.useful.gh_useful import gh_component_timer

guid = str(ghenv.Component.InstanceGuid)

counter_key = "counter_" + guid
pressed_key = "pressed_" + guid

max_num = len(array)

if counter_key not in st:
    st[counter_key] = 0

if pressed_key not in st:
    st[pressed_key] = False

else:
    if start:
        st[counter_key] = 0
        gh_component_timer(ghenv, True, timestep)
        st[pressed_key] = True
    else:
        if st[counter_key] < (max_num - 1) and st[pressed_key]:
            st[counter_key] += 1
            gh_component_timer(ghenv, True, timestep)
        else:
            st[pressed_key] = False

if len(array):
    item = array[st[counter_key]]
# ---------- end timer ----------
urrep = PythonScript(show=show, joints=timer)  # -> link_geo, tool_geo, tcp_plane, tool_plane, workspace; inputs joints: list
# ---------- urrep: Python ----------
if show and joints != [None]:
    link_geo, axes, tcp_plane, tool_plane, workspace, tool_geo = ur5.get_geo_with_rotated_joints(joints)
# ---------- end urrep ----------
preview = CustomPreview(Geometry=urrep.link_geo, Shader=ColourSwatch(SwatchColor=RGBA(85, 134, 161, 100)))
# inclination_length for 2, 4, 10, 15
# inclination_length for 30
# Calculate edge curves
preview_2 = CustomPreview(Geometry=urrep.tool_geo, Shader=ColourSwatch(SwatchColor=RGB(40, 39, 61)))

# ==== cluster Tools
measurement_tool_geo = Geometry([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])
bang = ClusterInput()
tool_name = ClusterInput()
py = PythonScript(rhino_geometry=measurement_tool_geo)  # -> measurement_tool; inputs rhino_geometry: list
# ---------- py: Python ----------
from compas_fabrication.fabrication.robots.ur.tools import MeasurementTool

measurement_tool = MeasurementTool()
measurement_tool.rhino_geometry = rhino_geometry
# ---------- end py ----------
tools = PythonScript(bang=bang, tool_name=tool_name, measurement_tool=py)  # -> tool
# ---------- tools: Python ----------
if tool_name == "measurement_tool":
    tool = measurement_tool
    print tool.tcp_frame
# ---------- end tools ----------
tool = ClusterOutput(tools)
